# Grasshopper definition Join Colinear Only.gh (Grasshopper 1.0.7)

crv_1 = Curve([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])
join = JoinCurves(Curves=crv_1, Preserve=False)
cp = ControlPoints(Curve=join)  # -> Points, Weights, Knots
crv_cp = CurveClosestPoint(Point=cp.Points, Curve=join)  # -> Point, Parameter, Distance
eval = EvaluateCurve(Curve=join, Parameter=crv_cp.Parameter)  # -> Point, Tangent, Angle
deg = Degrees(Radians=eval.Angle)
smaller = SmallerThan(FirstNumber=deg, SecondNumber=Slider(29.378, range=0..180))  # -> SmallerThan, OrEqualTo
cull = CullPattern(List=crv_cp.Parameter, CullPattern=invert(smaller.SmallerThan))
cset = CreateSet(List=cull)  # -> Set, Map

shatter = Shatter(Curve=join, Parameters=cset.Set)
midpt = CurveMiddle(Curve=shatter)
points = PointList(Points=midpt, Size=Slider(3.921, range=0..10))
