# Grasshopper definition Join Colinear Only_v.1.0.0.gh (Grasshopper 1.0.8)
# plug-ins: Pufferfish, Bifocals

# ----
# collinear points
surface = Surface([<surface referenced from the Rhino model> x40])
debrep = DeconstructBrep(Brep=surface)  # -> Faces, Edges, Vertices
reparamsrf = ReparameterizeSurface(Surface=debrep.Faces)  # -> Reparameterized, Original
ghpython_script = GhPythonScript(surface=reparamsrf.Reparameterized, angle=Slider(25.035, range=0..180))  # -> out, colinear_points; inputs surface: Brep
# ---------- ghpython_script: Python ----------
"""Provides a scripting component.
    Inputs:
        surface: The surface script variable
        angle: The angle script variable
    Output:
        colinear points: The a output variable"""

__author__ = "sherft"
__version__ = "2024.06.13"

import rhinoscriptsyntax as rs
import ghpythonlib.components as ghc
import Rhino.Geometry as rg
import math

def meshEdges(surface, angle):
    # Convert surface to mesh
    mesh = rg.Mesh.CreateFromBrep(surface)[0]
    
    # Get naked edges
    naked_edges = mesh.GetNakedEdges()
    
    # Convert naked edges to curves
    curves = []
    for edge in naked_edges:
        if isinstance(edge, rg.Polyline):
            curves.append(edge.ToPolylineCurve())
        else:
            curves.append(edge)
    
    # Join naked edges
    joined_curves = rg.Curve.JoinCurves(curves) 
    
    # Explode joined curves into segments
    exploded_curves = []
    for curve in joined_curves:
        exploded_curves.extend(curve.DuplicateSegments())
        
    # Get endpoints of each segment
    end_points = []
    for curve in exploded_curves:
        end_points.append(curve.PointAtEnd)  
        
     # Calculate angles between consecutive segments
    angles = []
    for i in range(len(exploded_curves)):
        vec_a = exploded_curves[i].TangentAtEnd
        vec_b = exploded_curves[(i + 1) % len(exploded_curves)].TangentAtStart
        newAngle = rg.Vector3d.VectorAngle(vec_a, vec_b)
        angles.append(newAngle)
        
    # Convert degree input to radians
    radian_limit = ghc.Radians(angle)
    
    # Smaller Than
    smaller_than = ghc.SmallerThan(radian_limit, angles)[0]
    
    # Cull Pattern
    cull_list = ghc.CullPattern(end_points, smaller_than)
        
    return cull_list
    
# Assume 'surface' and 'angle' are provided inputs
colinear_points = meshEdges(surface, angle)
# ---------- end ghpython_script ----------
point = Point(ghpython_script.colinear_points)
