# Grasshopper definition Join Colinear Only_v.0.0.1.gh (Grasshopper 1.0.7)

srf = Surface([<surface referenced from the Rhino model> x44])
ungroup = Ungroup(Group=srf)

crv_1 = Curve(srf)
join_curves = JoinCurves(Curves=crv_1, Preserve=False)
control_points = ControlPoints(Curve=join_curves)  # -> Points, Weights, Knots
curve_closest_point = CurveClosestPoint(Point=control_points.Points, Curve=join_curves)  # -> Point, Parameter, Distance
evaluate_curve = EvaluateCurve(Curve=join_curves, Parameter=curve_closest_point.Parameter)  # -> Point, Tangent, Angle
degrees = Degrees(Radians=evaluate_curve.Angle)
smaller_than = SmallerThan(FirstNumber=degrees, SecondNumber=Slider(29.378, range=0..180))  # -> SmallerThan, OrEqualTo
cull_pattern = CullPattern(List=curve_closest_point.Parameter, CullPattern=invert(smaller_than.SmallerThan))
create_set = CreateSet(List=cull_pattern)  # -> Set, Map
shatter = Shatter(Curve=join_curves, Parameters=create_set.Set)

crv = Curve(shatter)
crv_2 = Curve(crv)
curve_middle = CurveMiddle(Curve=shatter)
end = EndPoints(Curve=crv_2)  # -> Start, End
cullpt = CullDuplicates(Points=[end.Start, end.End], Tolerance=0.1, CullMode=3)  # -> Points, Indices, Valence
rev = ReverseList(List=cullpt.Points)
shift = ShiftList(List=rev, Shift=Slider(2, range=0..10), Wrap=True)
panel = Panel(rev)
