# Grasshopper definition Join Colinear Only_v.0.0.2.gh (Grasshopper 1.0.7)
# plug-ins: Bifocals

srf = Surface([<surface referenced from the Rhino model> x44])

surface = Surface([<surface referenced from the Rhino model> x44])
deconstruct_brep = DeconstructBrep(Brep=surface)  # -> Faces, Edges, Vertices
edges_from_points = EdgesFromPoints(Brep=surface, Points=deconstruct_brep.Vertices, Valence=1)  # -> Edges, Indices, Map
end_points = EndPoints(Curve=edges_from_points.Edges)  # -> Start, End
cull_duplicates = CullDuplicates(Points=[end_points.Start, end_points.End], Tolerance=Slider(0, range=0..100), CullMode=1)  # -> Points, Indices, Valence
rev = ReverseList(List=cull_duplicates.Points)
shift = ShiftList(List=rev, Shift=Slider(3, range=0..10), Wrap=True)

ungroup = Ungroup(Group=srf)
deconstruct_brep_2 = DeconstructBrep(Brep=srf)  # -> Faces, Edges, Vertices
edges_from_points_2 = EdgesFromPoints(Brep=srf, Points=deconstruct_brep_2.Vertices, Valence=1)  # -> Edges, Indices, Map
curve = Curve(edges_from_points_2.Edges)
simplify_curve = SimplifyCurve(Curve=curve)  # -> Curve, Simplified
curve_2 = Curve(deconstruct_brep_2.Edges)
simplify_curve_2 = SimplifyCurve(Curve=curve_2)  # -> Curve, Simplified
join_curves = JoinCurves(Curves=simplify_curve.Curve, Preserve=False)
explode = Explode(Curve=join_curves, Recursive=True)  # -> Segments, Vertices
number_slider = Slider(0.05, range=0..0.1)
curve_3 = Curve(explode.Segments)
crv = Curve(explode.Segments)
crv_2 = Curve(crv)
extend_curve = ExtendCurve(Curve=simplify_curve_2.Curve, Type=0, Start=number_slider, End=number_slider)
end = EndPoints(Curve=curve)  # -> Start, End

crv_1 = Curve(srf)
join_curves_2 = JoinCurves(Curves=crv_1, Preserve=False)
control_points = ControlPoints(Curve=join_curves_2)  # -> Points, Weights, Knots
curve_closest_point = CurveClosestPoint(Point=control_points.Points, Curve=join_curves_2)  # -> Point, Parameter, Distance
evaluate_curve = EvaluateCurve(Curve=join_curves_2, Parameter=curve_closest_point.Parameter)  # -> Point, Tangent, Angle
degrees = Degrees(Radians=evaluate_curve.Angle)
smaller_than = SmallerThan(FirstNumber=degrees, SecondNumber=Slider(29.378, range=0..180))  # -> SmallerThan, OrEqualTo
cull_pattern = CullPattern(List=curve_closest_point.Parameter, CullPattern=invert(smaller_than.SmallerThan))
create_set = CreateSet(List=cull_pattern)  # -> Set, Map
shatter = Shatter(Curve=join_curves_2, Parameters=create_set.Set)

ghpython_script = GhPythonScript(curves=crv_1, secondNumber=Slider(29.378, range=0..180))  # -> out, Midpoint, Segments; inputs curves: list of Curve
# ---------- ghpython_script: Python ----------
"""Provides a scripting component.
    Inputs:
        curves: The curves script variable
        secondNumber: The secondNumber script variable
    Output:
        out: The out output variable
        Midpoint: The Midpoint output variable
        Segments: The Segments output variable"""


__author__ = "sherft"
__version__ = "2024.06.10"

import ghpythonlib.components as ghc

preserve = False

curves_joinCurves = []

for curve in curves:
    curves_joinCurves.append(ghc.JoinCurves(curve, preserve))

points_controlPoints = ghc.ControlPoints(curves_joinCurves)[0]

parameter_curveClosestPoint = ghc.CurveClosestPoint(points_controlPoints, curves_joinCurves)[1]

angle_evaluateCurve = ghc.EvaluateCurve(curves_joinCurves, parameter_curveClosestPoint)[2] 

degrees_degrees = ghc.Degrees(angle_evaluateCurve)

largerThan_smallerThan = ghc.LargerThan(degrees_degrees, secondNumber)[0]

list_cullPattern = ghc.CullPattern(parameter_curveClosestPoint, largerThan_smallerThan)

set_createSet = ghc.CreateSet(list_cullPattern)[0]

segments_shatter = ghc.Shatter(curves_joinCurves, set_createSet)

midpoint_curveMiddle = ghc.CurveMiddle(segments_shatter)

Midpoint = midpoint_curveMiddle

Segments = segments_shatter
# ---------- end ghpython_script ----------
crv_3 = Curve(shatter)
crv_4 = Curve(crv_3)
end_2 = EndPoints(Curve=crv_4)  # -> Start, End
cullpt = CullDuplicates(Points=[end_2.Start, end_2.End], Tolerance=0.1, CullMode=3)  # -> Points, Indices, Valence
rev_2 = ReverseList(List=cullpt.Points)
shift_2 = ShiftList(List=rev_2, Shift=Slider(2, range=0..10), Wrap=True)
panel = Panel(rev_2)
join_curves_3 = JoinCurves(Curves=extend_curve, Preserve=False)
curve_4 = Curve(join_curves_3)
cullpt_2 = CullDuplicates(Points=[end.Start, end.End], Tolerance=Slider(0, range=0..1), CullMode=1)  # -> Points, Indices, Valence
point = Point(cullpt_2.Points)
rev_3 = ReverseList(List=cullpt_2.Points)
shift_3 = ShiftList(List=rev_3, Shift=Slider(2, range=0..10), Wrap=True)
panel_2 = Panel(rev_3)
curve_middle = CurveMiddle(Curve=shatter)
