# Grasshopper definition Join Colinear Only_v.0.0.3.gh (Grasshopper 1.0.7)

curve = Curve([<curve referenced from the Rhino model> x6])
split_planar_curve_and_curve = GhPythonScript(listOfCurves=curve)  # -> out, planarCurve, curve
# ---------- split_planar_curve_and_curve: Python ----------
__author__ = "sherft"
__version__ = "2024.06.12"

import rhinoscriptsyntax as rs

def curveplanar(x):
    return rs.IsCurvePlanar(x)
    
curveList = []
planarList = []    
    
if curveplanar(listOfCurves):
    planarList.append(listOfCurves)
else:
    curveList.append(listOfCurves)
        
planarCurve = planarList
curve = curveList
# ---------- end split_planar_curve_and_curve ----------
curve_2 = Curve(split_planar_curve_and_curve.curve)
curve_3 = Curve(split_planar_curve_and_curve.planarCurve)
