# Grasshopper definition Join Colinear Only_v.0.0.4.gh (Grasshopper 1.0.7)

panel = Panel("""0
1
2""")
srf = Surface()
surface = Surface([<surface referenced from the Rhino model> x44])
ungroup = Ungroup(Group=srf)
list_item = ListItem(List=surface, Index=Slider(1, range=0..43), Wrap=True)
surface_2 = Surface(list_item)
ghpython_script = GhPythonScript()  # -> out, a
# ---------- ghpython_script: Python ----------
# split a brep edge example (c) 2018, Clement Greiner - CG3D

import Rhino
import scriptcontext
import rhinoscriptsyntax as rs

def SplitBrepEdge():
    '''Split a brep edge'''
    
    # get edge to split
    ge = Rhino.Input.Custom.GetObject()
    ge.SetCommandPrompt("Select Edge to split")
    ge.GeometryFilter = Rhino.DocObjects.ObjectType.EdgeFilter
    ge.GeometryFilter = Rhino.DocObjects.ObjectType.Curve
    ge.DisablePreSelect()
    ge.BottomObjectPreference = False
    f = Rhino.Input.Custom.GeometryAttributeFilter
    ge.GeometryAttributeFilter = f.EdgeCurve | f.SurfaceBoundaryEdge | f.OuterLoop | f.MatedEdge
    ge.Get()
    if ge.CommandResult() != Rhino.Commands.Result.Success:
        return
    
    # edge pick results
    objRef = ge.Object(0)
    brep = objRef.Brep()
    edge_index = objRef.Edge().EdgeIndex
    ge.Dispose()
    
    # get a point on the edge
    gp = Rhino.Input.Custom.GetPoint()
    gp.SetCommandPrompt("Point to split edge")
    gp.Constrain(objRef.Edge(), False)
    gp.Get()
    if gp.CommandResult()!=Rhino.Commands.Result.Success:
        return 

    # point pick result
    pt = gp.Point()
    gp.Dispose()

    # split the edge at the picked point
    rc, param = brep.Edges[edge_index].ClosestPoint(pt)
    if rc:    
        brep.Edges.SplitEdgeAtParameters(edge_index, [param])
        brep.Compact()
        scriptcontext.doc.Objects.Replace(objRef.ObjectId, brep)
        scriptcontext.doc.Views.Redraw()

SplitBrepEdge()
# ---------- end ghpython_script ----------
mesh_edges = MeshEdges(Mesh=surface_2)  # -> NakedEdges, InteriorEdges, NonManifoldEdges
line = Line(mesh_edges.NakedEdges)
join_curves = JoinCurves(Curves=line, Preserve=False)
curve = Curve(join_curves)
end_points = EndPoints(Curve=line)  # -> Start, End

surface_3 = Surface(<surface referenced from the Rhino model>)
deconstruct_brep = DeconstructBrep(Brep=surface_3)  # -> Faces, Edges, Vertices

divide_curve = DivideCurve(Curve=deconstruct_brep.Edges, Count=10, Kinks=False)  # -> Points, Tangents, Parameters
polyline = PolyLine(Vertices=divide_curve.Points, Closed=False)

crv_1 = Curve(srf)
join_curves_2 = JoinCurves(Curves=polyline, Preserve=False)
control_points = ControlPoints(Curve=curve)  # -> Points, Weights, Knots
curve_closest_point = CurveClosestPoint(Point=control_points.Points, Curve=curve)  # -> Point, Parameter, Distance
evaluate_curve = EvaluateCurve(Curve=curve, Parameter=curve_closest_point.Parameter)  # -> Point, Tangent, Angle
degrees = Degrees(Radians=evaluate_curve.Angle)
smaller_than = SmallerThan(FirstNumber=degrees, SecondNumber=Slider(29.378, range=0..180))  # -> SmallerThan, OrEqualTo
cull_pattern = CullPattern(List=curve_closest_point.Parameter, CullPattern=invert(smaller_than.SmallerThan))
create_set = CreateSet(List=cull_pattern)  # -> Set, Map
shatter = Shatter(Curve=curve, Parameters=create_set.Set)

end_points_2 = EndPoints(Curve=polyline)  # -> Start, End
cull_duplicates = CullDuplicates(Points=[end_points_2.Start, end_points_2.End], Tolerance=Slider(0, range=0..100), CullMode=1)  # -> Points, Indices, Valence
rev = ReverseList(List=cull_duplicates.Points)
shift = ShiftList(List=rev, Shift=Slider(3, range=0..10), Wrap=True)

crv = Curve(shatter)
crv_2 = Curve(crv)
curve_middle = CurveMiddle(Curve=shatter)
end = EndPoints(Curve=crv_2)  # -> Start, End
cullpt = CullDuplicates(Points=[end.Start, end.End], Tolerance=0.1, CullMode=3)  # -> Points, Indices, Valence
rev_2 = ReverseList(List=cullpt.Points)
shift_2 = ShiftList(List=rev_2, Shift=Slider(2, range=0..10), Wrap=True)
point = Point(shift_2)
panel_2 = Panel(rev_2)
