# Grasshopper definition Join Colinear Only_v.0.0.5.gh (Grasshopper 1.0.7)
# plug-ins: Bifocals, Heteroptera, Pufferfish

surface = Surface([<surface referenced from the Rhino model> x40])
surface_2 = Surface([<surface referenced from the Rhino model> x44])
ghpython_script = GhPythonScript(surface=surface, angle=Slider(25.035, range=0..180))  # -> out, colinear_points; inputs surface: Brep
# ---------- ghpython_script: Python ----------
"""Provides a scripting component.
    Inputs:
        surface: The surface script variable
        angle: The angle script variable
    Output:
        colinear points: The a output variable"""

__author__ = "sherft"
__version__ = "2024.06.13"

import rhinoscriptsyntax as rs
import ghpythonlib.components as ghc
import Rhino.Geometry as rg
import math

def meshEdges(surface, angle):
    # Convert surface to mesh
    mesh = rg.Mesh.CreateFromBrep(surface)[0]
    
    # Get naked edges
    naked_edges = mesh.GetNakedEdges()
    
    # Convert naked edges to curves
    curves = []
    for edge in naked_edges:
        if isinstance(edge, rg.Polyline):
            curves.append(edge.ToPolylineCurve())
        else:
            curves.append(edge)
    
    # Join naked edges
    joined_curves = rg.Curve.JoinCurves(curves) 
    
    # Explode joined curves into segments
    exploded_curves = []
    for curve in joined_curves:
        exploded_curves.extend(curve.DuplicateSegments())
        
    # Get endpoints of each segment
    end_points = []
    for curve in exploded_curves:
        end_points.append(curve.PointAtEnd)  
        
     # Calculate angles between consecutive segments
    angles = []
    for i in range(len(exploded_curves)):
        vec_a = exploded_curves[i].TangentAtEnd
        vec_b = exploded_curves[(i + 1) % len(exploded_curves)].TangentAtStart
        newAngle = rg.Vector3d.VectorAngle(vec_a, vec_b)
        angles.append(newAngle)
        
    # Convert degree input to radians
    radian_limit = ghc.Radians(angle)
    
    # Smaller Than
    smaller_than = ghc.SmallerThan(radian_limit, angles)[0]
    
    # Cull Pattern
    cull_list = ghc.CullPattern(end_points, smaller_than)
        
    return cull_list
    
# Assume 'surface' and 'angle' are provided inputs
colinear_points = meshEdges(surface, angle)
# ---------- end ghpython_script ----------
surface_from_points = SurfaceFromPoints(Interpolate=False)
mesh = Mesh(surface_2)
surface_3 = Surface([<surface referenced from the Rhino model> x88])
mesh_2 = Mesh(surface_3)
mesh_edges = MeshEdges(Mesh=mesh_2)  # -> NakedEdges, InteriorEdges, NonManifoldEdges
meshcorners = MeshCorners(M=mesh, A=0.5235987756)
simplify_curve = SimplifyCurve(Curve=mesh_edges.NakedEdges)  # -> Curve, Simplified
point = Point(ghpython_script.colinear_points)
number_slider = Slider(0.1, range=-0.9..0.1)
number_slider_2 = Slider(0.1, range=0..0.1)
deconstruct_brep = DeconstructBrep()  # -> Faces, Edges, Vertices
curve = Curve(mesh_edges.NakedEdges)
point_2 = Point(meshcorners)
divide_curve = DivideCurve(Curve=curve, Count=10, Kinks=False)  # -> Points, Tangents, Parameters
edges_from_points = EdgesFromPoints(Brep=surface_3, Points=divide_curve.Points, Valence=1)  # -> Edges, Indices, Map
extend_curve = ExtendCurve(Curve=edges_from_points.Edges, Type=0, Start=number_slider, End=number_slider)
bounding_box = BoundingBox(Content=extend_curve, Plane=PlaneXY(0, 0, 0), UnionBox=True)  # -> Box, Box_2
box = Box(bounding_box.Box)
deconstruct_brep_2 = DeconstructBrep(Brep=surface_2)  # -> Faces, Edges, Vertices
edges_from_points_2 = EdgesFromPoints(Brep=surface_2, Points=deconstruct_brep_2.Vertices, Valence=1)  # -> Edges, Indices, Map
curve_2 = Curve(edges_from_points_2.Edges)
join_curves = JoinCurves(Curves=deconstruct_brep.Edges, Preserve=False)
ghpython_script_2 = GhPythonScript(colinear_points=point)  # -> out, a; inputs colinear_points: list of Point3d
# ---------- ghpython_script_2: Python ----------
"""
Provides a scripting component.
Inputs:
    colinear_points: The colinear points from the previous component
Output:
    sorted_points: The sorted points in clockwise direction

__author__ = "sherft"
__version__ = "2024.06.13"
"""

import Rhino.Geometry as rg
import math

def sort_points_clockwise(points):
    # Calculate the centroid of the points
    centroid = rg.Point3d(0, 0, 0)
    for pt in points:
        centroid += pt
    centroid /= len(points)
    
    # Sort points based on their angle relative to the centroid
    def angle_from_centroid(point):
        vec = point - centroid
        angle = math.atan2(vec.Y, vec.X)
        return angle
    
    sorted_points = sorted(points, key=angle_from_centroid)
    
    return sorted_points

# Call the function
sorted_points = sort_points_clockwise(colinear_points)

# Output
a = sorted_points  # Output sorted points
# ---------- end ghpython_script_2 ----------
area = Area(Geometry=box)  # -> Area, Centroid
geometric_cell = GeometricCell(Curves=edges_from_points.Edges)
simplify_curve_2 = SimplifyCurve(Curve=curve_2)  # -> Curve, Simplified
scale = Scale(Geometry=box, Center=area.Centroid, Factor=Slider(2, range=0..10))  # -> Geometry, Transform
list_item = ListItem(List=ghpython_script_2.a, Index=Slider(0, range=0..6), Wrap=True)
curve_3 = Curve(deconstruct_brep_2.Edges)
simplify_curve_3 = SimplifyCurve(Curve=curve_3)  # -> Curve, Simplified
discontinuity = Discontinuity(Curve=edges_from_points.Edges, Level=1)  # -> Points, Parameters
surface_split = SurfaceSplit(Surface=scale.Geometry, Curves=extend_curve)
join_curves_2 = JoinCurves(Curves=simplify_curve_2.Curve, Preserve=False)
explode = Explode(Curve=join_curves_2, Recursive=True)  # -> Segments, Vertices
number_slider_3 = Slider(0.05, range=0..0.1)
curve_4 = Curve(explode.Segments)
curve_5 = Curve(explode.Segments)
curve_6 = Curve(curve_5)
extend_curve_2 = ExtendCurve(Curve=simplify_curve_3.Curve, Type=0, Start=number_slider_3, End=number_slider_3)
end_points = EndPoints(Curve=curve_2)  # -> Start, End

crv_1 = Curve(surface_2)
join_curves_3 = JoinCurves(Curves=crv_1, Preserve=False)
control_points = ControlPoints(Curve=join_curves_3)  # -> Points, Weights, Knots
curve_closest_point = CurveClosestPoint(Point=control_points.Points, Curve=join_curves_3)  # -> Point, Parameter, Distance
evaluate_curve = EvaluateCurve(Curve=join_curves_3, Parameter=curve_closest_point.Parameter)  # -> Point, Tangent, Angle
degrees = Degrees(Radians=evaluate_curve.Angle)
smaller_than = SmallerThan(FirstNumber=degrees, SecondNumber=Slider(29.378, range=0..180))  # -> SmallerThan, OrEqualTo
cull_pattern = CullPattern(List=curve_closest_point.Parameter, CullPattern=invert(smaller_than.SmallerThan))
create_set = CreateSet(List=cull_pattern)  # -> Set, Map
shatter = Shatter(Curve=join_curves_3, Parameters=create_set.Set)

ghpython_script_3 = GhPythonScript(curves=crv_1)  # -> out, Midpoint, Segments; inputs curves: list of Curve
# ---------- ghpython_script_3: Python ----------
"""Provides a scripting component.
    Inputs:
        curves: The curves script variable
        secondNumber: The secondNumber script variable
    Output:
        out: The out output variable
        Midpoint: The Midpoint output variable
        Segments: The Segments output variable"""


__author__ = "sherft"
__version__ = "2024.06.10"

import ghpythonlib.components as ghc

preserve = False

curves_joinCurves = []

for curve in curves:
    curves_joinCurves.append(ghc.JoinCurves(curve, preserve))

points_controlPoints = ghc.ControlPoints(curves_joinCurves)[0]

parameter_curveClosestPoint = ghc.CurveClosestPoint(points_controlPoints, curves_joinCurves)[1]

angle_evaluateCurve = ghc.EvaluateCurve(curves_joinCurves, parameter_curveClosestPoint)[2] 

degrees_degrees = ghc.Degrees(angle_evaluateCurve)

largerThan_smallerThan = ghc.LargerThan(degrees_degrees, secondNumber)[0]

list_cullPattern = ghc.CullPattern(parameter_curveClosestPoint, largerThan_smallerThan)

set_createSet = ghc.CreateSet(list_cullPattern)[0]

segments_shatter = ghc.Shatter(curves_joinCurves, set_createSet)

midpoint_curveMiddle = ghc.CurveMiddle(segments_shatter)

Midpoint = midpoint_curveMiddle

Segments = segments_shatter
# ---------- end ghpython_script_3 ----------
curve_7 = Curve(shatter)
curve_8 = Curve(curve_7)
end_points_2 = EndPoints(Curve=curve_8)  # -> Start, End
cull_duplicates = CullDuplicates(Points=[end_points_2.Start, end_points_2.End], Tolerance=0.1, CullMode=3)  # -> Points, Indices, Valence
reverse_list = ReverseList(List=cull_duplicates.Points)
shift_list = ShiftList(List=reverse_list, Shift=Slider(2, range=0..10), Wrap=True)
panel = Panel(reverse_list)
join_curves_4 = JoinCurves(Curves=extend_curve_2, Preserve=False)
curve_9 = Curve(join_curves_4)
cull_duplicates_2 = CullDuplicates(Points=[end_points.Start, end_points.End], Tolerance=Slider(0, range=0..1), CullMode=1)  # -> Points, Indices, Valence

surface_4 = Surface(<surface referenced from the Rhino model>)
mesh_3 = Mesh(surface_4)
mesh_edges_2 = MeshEdges(Mesh=surface_4)  # -> NakedEdges, InteriorEdges, NonManifoldEdges
join_curves_5 = JoinCurves(Curves=mesh_edges_2.NakedEdges, Preserve=False)
explode_2 = Explode(Curve=join_curves_5, Recursive=True)  # -> simplify(Segments), Vertices
shift_list_2 = ShiftList(List=explode_2.Segments, Shift=1, Wrap=True)  # -> simplify(List)
radians = Radians(Degrees=Slider(25.035, range=0..180))
angle = Angle(VectorA=explode_2.Segments, VectorB=shift_list_2)  # -> Angle, Reflex
end_points_3 = EndPoints(Curve=explode_2.Segments)  # -> Start, End
smaller_than_2 = SmallerThan(FirstNumber=radians, SecondNumber=angle.Angle)  # -> SmallerThan, OrEqualTo
cull_pattern_2 = CullPattern(List=end_points_3.End, CullPattern=smaller_than_2.SmallerThan)  # -> flatten(List)

point_3 = Point(cull_duplicates_2.Points)
reverse_list_2 = ReverseList(List=cull_duplicates_2.Points)
shift_list_3 = ShiftList(List=reverse_list_2, Shift=Slider(2, range=0..10), Wrap=True)
surface_5 = Surface([<surface referenced from the Rhino model> x88])
panel_2 = Panel(reverse_list_2)
curve_to_polyline = CurveToPolyline(Curve=surface_5, ToleranceDistance=0, ToleranceAngle=0)  # -> Polyline, Segments
polyline_to_mesh = PolylineToMesh(Polyline=curve_to_polyline.Polyline, Quadrangulate=True)
mesh_brep = MeshBrep(
    Brep=surface_5,
    Settings={GridMaxCount=0, GridMinCount=16, JaggedSeams=False, MaxEdgeLength=0, MinEdgeLength=0.0001, MinTolerance=0, Refine=True, RefineAngle=0, RelativeTolerance=0.65, SimplePlanes=True, Tolerance=0})
mesh_edges_3 = MeshEdges(Mesh=polyline_to_mesh)  # -> NakedEdges, InteriorEdges, NonManifoldEdges
mesh_edges_4 = MeshEdges(Mesh=mesh_brep)  # -> NakedEdges, InteriorEdges, NonManifoldEdges
number_slider_4 = Slider(0.1, range=-0.9..0.1)
extend_curve_3 = ExtendCurve(Curve=mesh_edges_3.NakedEdges, Type=0, Start=number_slider_4, End=number_slider_4)
param_viewer = ParamViewer(angle.Angle)
geometric_cell_2 = GeometricCell(Curves=extend_curve_3)
panel_3 = Panel(smaller_than_2.SmallerThan)
discontinuity_2 = Discontinuity(Curve=geometric_cell_2, Level=1)  # -> Points, Parameters
curve_middle = CurveMiddle(Curve=shatter)

surface_6 = Surface(graft([<surface referenced from the Rhino model> x88]))

panel_4 = Panel(surface_6)
mesh_4 = Mesh(surface_6)
mesh_edges_5 = MeshEdges(Mesh=mesh_4)  # -> NakedEdges, InteriorEdges, NonManifoldEdges
extend_curve_4 = ExtendCurve(Curve=mesh_edges_5.NakedEdges, Type=0, Start=number_slider_2, End=number_slider_2)

end_points_4 = EndPoints(Curve=extend_curve_4)  # -> Start, End
cull_duplicates_3 = CullDuplicates(Points=[end_points_4.Start, end_points_4.End], Tolerance=Slider(0, range=0..100), CullMode=1)  # -> Points, Indices, Valence
reverse_list_3 = ReverseList(List=cull_duplicates_3.Points)
shift_list_4 = ShiftList(List=reverse_list_3, Shift=Slider(3, range=0..10), Wrap=True)

# ==== cluster MeshCorners: Finds the corners of the boundary of a mesh
M = ClusterInput()
medges = MeshEdges(Mesh=M)  # -> NakedEdges, InteriorEdges, NonManifoldEdges
join = JoinCurves(Curves=medges.NakedEdges, Preserve=False)
explode = Explode(Curve=join, Recursive=True)  # -> simplify(Segments), Vertices
shift = ShiftList(List=explode.Segments, Shift=1, Wrap=True)  # -> simplify(List)
end = EndPoints(Curve=explode.Segments)  # -> Start, End
angle = Angle(VectorA=explode.Segments, VectorB=shift)  # -> Angle, Reflex
A = ClusterInput()
smaller = SmallerThan(FirstNumber=A, SecondNumber=angle.Angle)  # -> SmallerThan, OrEqualTo
cull = CullPattern(List=end.End, CullPattern=smaller.SmallerThan)  # -> flatten(List)
L = ClusterOutput(cull)
