# Grasshopper definition Join Colinear Only_v.0.2.0.gh (Grasshopper 1.0.7)

crv_1 = Curve([<curve referenced from the Rhino model> x46])
ghpython_script = GhPythonScript(curves=crv_1, secondNumber=Slider(29.378, range=0..180))  # -> out, Midpoint, Segments; inputs curves: list of Curve
# ---------- ghpython_script: Python ----------
import ghpythonlib.components as ghc

if curves is not None:
    preserve = False
    
    curves_joinCurves = ghc.JoinCurves(curves, preserve)
    
    points_controlPoints = ghc.ControlPoints(curves_joinCurves)[0]
    
    parameter_curveClosestPoint = ghc.CurveClosestPoint(points_controlPoints, curves_joinCurves)[1]
    
    angle_evaluateCurve = ghc.EvaluateCurve(curves_joinCurves, parameter_curveClosestPoint)[2] 
    
    degrees_degrees = ghc.Degrees(angle_evaluateCurve)
    
    largerThan_smallerThan = ghc.LargerThan(degrees_degrees, secondNumber)[0]
    
    list_cullPattern = ghc.CullPattern(parameter_curveClosestPoint, largerThan_smallerThan)
    
    set_createSet = ghc.CreateSet(list_cullPattern)[0]
    
    segments_shatter = ghc.Shatter(curves_joinCurves, set_createSet)
    
    midpoint_curveMiddle = ghc.CurveMiddle(segments_shatter)
    
    Midpoint = midpoint_curveMiddle
    
    Segments = segments_shatter
# ---------- end ghpython_script ----------
panel = Panel(ghpython_script.Midpoint)
panel_2 = Panel(ghpython_script.Segments)

crv_1_2 = Curve([<curve referenced from the Rhino model> x14])
join_curves = JoinCurves(Curves=crv_1_2, Preserve=False)
control_points = ControlPoints(Curve=join_curves)  # -> Points, Weights, Knots
curve_closest_point = CurveClosestPoint(Point=control_points.Points, Curve=join_curves)  # -> Point, Parameter, Distance
evaluate_curve = EvaluateCurve(Curve=join_curves, Parameter=curve_closest_point.Parameter)  # -> Point, Tangent, Angle
degrees = Degrees(Radians=evaluate_curve.Angle)
smaller_than = SmallerThan(FirstNumber=degrees, SecondNumber=Slider(29.378, range=0..180))  # -> SmallerThan, OrEqualTo
cull_pattern = CullPattern(List=curve_closest_point.Parameter, CullPattern=invert(smaller_than.SmallerThan))
create_set = CreateSet(List=cull_pattern)  # -> Set, Map
shatter = Shatter(Curve=join_curves, Parameters=create_set.Set)

curve_middle = CurveMiddle(Curve=shatter)
panel_3 = Panel(curve_middle)
point_list = PointList(Points=curve_middle, Size=Slider(3.921, range=0..10))
