# Grasshopper definition Selective curve merging_2023Jan13a.gh (Grasshopper 1.0.7)

crv_1 = Curve([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])
crv_2 = Curve([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])
entwine = Entwine(Branch00=crv_1, Branch01=crv_2, FlattenInputs=True)
join = JoinCurves(Curves=entwine, Preserve=False)
disc = Discontinuity(Curve=join, Level=1)  # -> Points, Parameters
shatter = Shatter(Curve=join, Parameters=disc.Parameters)
len = Length(Curve=shatter)
avr = Average(Input=len)
larger = LargerThan(FirstNumber=len, SecondNumber=avr)  # -> LargerThan, OrEqualTo
dispatch = Dispatch(List=shatter, DispatchPattern=larger.LargerThan)  # -> ListA, ListB
join_2 = JoinCurves(Curves=dispatch.ListB, Preserve=False)
weave = Weave(Pattern=[0, 1], Stream0=dispatch.ListA, Stream1=join_2, NullGaps=False)
colorj = ColorfulJitter(geo=weave, jitter=Slider(0.25, range=0..1), seed=2)
panel = Panel(weave)

# ==== cluster ColorfulJitter: Derived from 'Colourful' (by HS Kim?) 12/18/2020
geo = ClusterInput()
jitter = ClusterInput()
seed = ClusterInput()
geo_2 = Geometry(geo)
clean = CleanTree(RemoveNulls=True, RemoveInvalid=True, RemoveEmpty=False, Tree=geo_2)
lng = ListLength(List=clean)
range = Range(Domain=Domain(0, 0.9), Steps=expr("x-1", lng))
combine = CombineData(Input0=range, Input1="0")  # -> Result, Index
hsl = ColourHSL(Alpha=1, Hue=combine.Result, Saturation=1, Luminance=0.5)
jitter_2 = Jitter(List=hsl, Jitter=jitter, Seed=seed)  # -> Values, Indices
preview = CustomPreview(Geometry=clean, Shader=jitter_2.Values)
