# Grasshopper definition Selective curve merging_re.gh (Grasshopper 1.0.7)

crv_1 = Curve([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])
crv_2 = Curve([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])
join = JoinCurves(Curves=crv_2, Preserve=False)
join_2 = JoinCurves(Curves=crv_1, Preserve=False)
cp = ControlPoints(Curve=join)  # -> Points, Weights, Knots
cp_2 = ControlPoints(Curve=join_2)  # -> Points, Weights, Knots
crv_cp = CurveClosestPoint(Point=cp.Points, Curve=join)  # -> Point, Parameter, Distance
crv_cp_2 = CurveClosestPoint(Point=cp_2.Points, Curve=join_2)  # -> Point, Parameter, Distance
eval = EvaluateCurve(Curve=join, Parameter=crv_cp.Parameter)  # -> Point, Tangent, Angle
eval_2 = EvaluateCurve(Curve=join_2, Parameter=crv_cp_2.Parameter)  # -> Point, Tangent, Angle
deg = Degrees(Radians=eval.Angle)
deg_2 = Degrees(Radians=eval_2.Angle)
smaller = SmallerThan(FirstNumber=deg, SecondNumber=Slider(29.378, range=0..180))  # -> SmallerThan, OrEqualTo
smaller_2 = SmallerThan(FirstNumber=deg_2, SecondNumber=Slider(29.378, range=0..180))  # -> SmallerThan, OrEqualTo
cull = CullPattern(List=crv_cp.Parameter, CullPattern=invert(smaller.SmallerThan))
cull_2 = CullPattern(List=crv_cp_2.Parameter, CullPattern=invert(smaller_2.SmallerThan))
cset = CreateSet(List=cull)  # -> Set, Map
cset_2 = CreateSet(List=cull_2)  # -> Set, Map

shatter = Shatter(Curve=join_2, Parameters=cset_2.Set)
midpt = CurveMiddle(Curve=shatter)
points = PointList(Points=midpt, Size=Slider(3.921, range=0..10))

shatter_2 = Shatter(Curve=join, Parameters=cset.Set)
midpt_2 = CurveMiddle(Curve=shatter_2)
points_2 = PointList(Points=midpt_2, Size=Slider(3.921, range=0..10))
