# Grasshopper definition straightener_RE.gh (Grasshopper 1.0.7)
# plug-ins: Human

crv = Curve(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)
explode = Explode(Curve=crv, Recursive=True)  # -> Segments, Vertices
X = UnitX(Factor=1)
angle = Angle(VectorA=explode.Segments, VectorB=X)  # -> Angle, Reflex
deg = Degrees(Radians=angle.Angle)
expression = Expression(x=deg, Expression="Cint (x)")
cset = CreateSet(List=expression)  # -> Set, Map
mindex = MemberIndex(Set=expression, Member=cset.Set)  # -> Index, Count
item = ListItem(List=explode.Segments, Index=mindex.Index, Wrap=True)
join = JoinCurves(Curves=item, Preserve=False)
midpoint = MIDPT(Curve=reparameterize(join), Parameter=0.5)  # -> flatten(Point), Tangent, Angle
alongcrv = SortAlongCurve(Points=midpoint.Point, Curve=crv)  # -> Points, Indices
item_2 = ListItem(List=flatten(join), Index=alongcrv.Indices, Wrap=True)
lng = ListLength(List=item_2)
wheel = ColourWheel(
    lng,
    ColourGrips_Style=30,
    ColourGrips_Grip=[6.143003434, 1.077824524, 4.348975288, 3.141592654],
    ColourGrips_Lum=[0.3723217351, 0.7839551184],
    ColourGrips_Range=[0.2447936162, 0.2447936162, 0.2447936162, 0.2447936162],
    ColourGrips_Sat=[0.3550336378, 0.9990089126])
jitter = Jitter(List=wheel, Jitter=1, Seed=Slider(41, range=0..100))  # -> Values, Indices
previewlw = CustomPreviewLineweights(Geometry=item_2, Shader=jitter.Values, Thickness=Slider(5.2, range=0..10), Absolute=False)
