# Grasshopper definition Sort Sides_v.0.0.1.gh (Grasshopper 1.0.7)
# plug-ins: Wombat, Sasquatch, Pufferfish, Bifocals

surface = Surface([<surface referenced from the Rhino model> x3003])
debrep = DeconstructBrep(Brep=surface)  # -> Faces, Edges, Vertices
reparamsrf = ReparameterizeSurface(Surface=debrep.Faces)  # -> Reparameterized, Original
ghpython_script = GhPythonScript(surface=reparamsrf.Reparameterized, angle=Slider(25.035, range=0..180))  # -> out, colinear_points; inputs surface: Brep
# ---------- ghpython_script: Python ----------
"""Provides a scripting component.
    Inputs:
        surface: The surface script variable
        angle: The angle script variable
    Output:
        colinear points: The a output variable"""

__author__ = "sherft"
__version__ = "2024.06.13"

import rhinoscriptsyntax as rs
import ghpythonlib.components as ghc
import Rhino.Geometry as rg
import math

def meshEdges(surface, angle):
    # Convert surface to mesh
    mesh = rg.Mesh.CreateFromBrep(surface)[0]
    
    # Get naked edges
    naked_edges = mesh.GetNakedEdges()
    
    # Convert naked edges to curves
    curves = []
    for edge in naked_edges:
        if isinstance(edge, rg.Polyline):
            curves.append(edge.ToPolylineCurve())
        else:
            curves.append(edge)
    
    # Join naked edges
    joined_curves = rg.Curve.JoinCurves(curves) 
    
    # Explode joined curves into segments
    exploded_curves = []
    for curve in joined_curves:
        exploded_curves.extend(curve.DuplicateSegments())
        
    # Get endpoints of each segment
    end_points = []
    for curve in exploded_curves:
        end_points.append(curve.PointAtEnd)  
        
     # Calculate angles between consecutive segments
    angles = []
    for i in range(len(exploded_curves)):
        vec_a = exploded_curves[i].TangentAtEnd
        vec_b = exploded_curves[(i + 1) % len(exploded_curves)].TangentAtStart
        newAngle = rg.Vector3d.VectorAngle(vec_a, vec_b)
        angles.append(newAngle)
        
    # Convert degree input to radians
    radian_limit = ghc.Radians(angle)
    
    # Smaller Than
    smaller_than = ghc.SmallerThan(radian_limit, angles)[0]
    
    # Cull Pattern
    cull_list = ghc.CullPattern(end_points, smaller_than)
        
    return cull_list
    
# Assume 'surface' and 'angle' are provided inputs
colinear_points = meshEdges(surface, angle)
# ---------- end ghpython_script ----------
point = Point(ghpython_script.colinear_points)
param_viewer = ParamViewer(ghpython_script.colinear_points)
panel = Panel(ghpython_script.colinear_points)
list_length = ListLength(List=point)
equality = Equality(FirstNumber=list_length, SecondNumber=Slider(4, range=0..10))  # -> Equality, Inequality
dispatch = Dispatch(List=point, DispatchPattern=equality.Equality)  # -> ListA, ListB
number_slider = Slider(2, range=0..10)
point_2 = Point(dispatch.ListB)
point_3 = Point(dispatch.ListA)
average = Average(Input=point_3)
cps = ClosestPoints(Point=average, Cloud=point, Count=4)  # -> ClosestPoint, CPIndex, Distance
panel_2 = Panel(cps.ClosestPoint)
tree_statistics = TreeStatistics(Tree=point_3)  # -> Paths, Length, Count
loft = Loft(Options={Adjust=False, Closed=False, LoftEnds=0, LoftSimp=0, LoftType=0, Rebuild=10, Refit=0.01})
tree_branch = TreeBranch(Tree=point_3, Path=tree_statistics.Paths, MaintainPaths=True)
tree_statistics_2 = TreeStatistics(Tree=cps.ClosestPoint)  # -> Paths, Length, Count
tree_branch_2 = TreeBranch(Tree=cps.ClosestPoint, Path=tree_statistics_2.Paths, MaintainPaths=True)
list_item = ListItem(List=tree_branch, Index=Slider(2, range=0..10), Wrap=True)
list_item_2 = ListItem(List=tree_branch, Index=0, Wrap=True)
list_item_3 = ListItem(List=tree_branch, Index=Slider(1, range=0..1), Wrap=True)
list_item_4 = ListItem(List=tree_branch, Index=Slider(3, range=0..10), Wrap=True)
line = Line(StartPoint=list_item_2, EndPoint=list_item_3)
line_2 = Line(StartPoint=list_item_3, EndPoint=list_item)
line_3 = Line(StartPoint=list_item, EndPoint=list_item_4)
line_4 = Line(StartPoint=list_item_4, EndPoint=list_item_2)
network_surface = NetworkSurface(CurvesU=[line, line_2], CurvesV=[line_3, line_4], Continuity=2)
flip = Flip(Surface=network_surface, Guide=<geometry referenced from the Rhino model>)  # -> Surface, Result
deconstruct_brep = DeconstructBrep(Brep=flip.Surface)  # -> Faces, Edges, Vertices
evaluate_surface = EvaluateSurface(Surface=deconstruct_brep.Faces, Point="0.5,0.5")  # -> Point, Normal, UDirection, VDirection, Frame
construct_plane = ConstructPlane(Origin=average, XAxis=evaluate_surface.UDirection, YAxis=evaluate_surface.VDirection)
surface_frames = SurfaceFrames(Surface=network_surface, UCount=number_slider, VCount=number_slider)  # -> Frames, Parameters
align = AlignPlanes(Planes=construct_plane)
deconstruct_plane = DeconstructPlane(Plane=surface_frames.Frames)  # -> Origin, XAxis, YAxis, ZAxis
sort_points_polar = SortPointsPolar(Points=point_3, ReferncePlane=align)  # -> SortedPoints, SortedValues
dot_product = DotProduct(VectorA=deconstruct_plane.ZAxis, VectorB=average, Unitize=False)
panel_3 = Panel(dot_product)
sort_list = SortList(Keys=dot_product, ValuesValuesA=network_surface)  # -> Keys, ValuesValuesA
list_item_5 = ListItem(List=tree_branch_2, Index=Slider(3, range=0..10), Wrap=True)
list_item_6 = ListItem(List=tree_branch_2, Index=Slider(3, range=0..10), Wrap=True)
list_item_7 = ListItem(List=tree_branch_2, Index=Slider(0, range=0..10), Wrap=True)
list_item_8 = ListItem(List=tree_branch_2, Index=Slider(2, range=0..10), Wrap=True)
list_item_9 = ListItem(List=tree_branch_2, Index=Slider(1, range=0..10), Wrap=True)
list_item_10 = ListItem(List=tree_branch_2, Index=Slider(0, range=0..10), Wrap=True)
list_item_11 = ListItem(List=tree_branch_2, Index=Slider(0, range=0..10), Wrap=True)
list_item_12 = ListItem(List=tree_branch_2, Index=Slider(3, range=0..10), Wrap=True)
midpoint = Midpoint(Curve=[line, line_4, line_2, line_3])
line_5 = Line(StartPoint=list_item_7, EndPoint=list_item_5)
line_6 = Line(StartPoint=list_item_9, EndPoint=list_item_6)
line_7 = Line(StartPoint=list_item_11, EndPoint=list_item_8)
line_8 = Line(StartPoint=list_item_12, EndPoint=list_item_10)
sort_list_2 = SortList(Keys=sort_list.Keys, ValuesValuesA=network_surface)  # -> Keys, ValuesValuesA
merge = Merge(Data1=line, Data2=line_2, Data3=line_3, Data4=line_4)
