# Grasshopper definition Sort Sides_v.0.0.2.gh (Grasshopper 1.0.7)
# plug-ins: Wombat, Sasquatch, Bifocals

number_slider = Slider(25.035, range=0..180)
surface = Surface([<surface referenced from the Rhino model> x3003])
ghpython_script = GhPythonScript(surface=surface, angle=number_slider)  # -> out, colinear_points; inputs surface: Brep
# ---------- ghpython_script: Python ----------
"""Provides a scripting component.
    Inputs:
        surface: The surface script variable
        angle: The angle script variable
    Output:
        colinear points: The a output variable"""

__author__ = "sherft"
__version__ = "2024.06.13"

import rhinoscriptsyntax as rs
import ghpythonlib.components as ghc
import Rhino.Geometry as rg
import math

def meshEdges(surface, angle):
    # Convert surface to mesh
    mesh = rg.Mesh.CreateFromBrep(surface)[0]
    
    # Get naked edges
    naked_edges = mesh.GetNakedEdges()
    
    # Convert naked edges to curves
    curves = []
    for edge in naked_edges:
        if isinstance(edge, rg.Polyline):
            curves.append(edge.ToPolylineCurve())
        else:
            curves.append(edge)
    
    # Join naked edges
    joined_curves = rg.Curve.JoinCurves(curves) 
    
    # Explode joined curves into segments
    exploded_curves = []
    for curve in joined_curves:
        exploded_curves.extend(curve.DuplicateSegments())
        
    # Get endpoints of each segment
    end_points = []
    for curve in exploded_curves:
        end_points.append(curve.PointAtEnd)  
        
     # Calculate angles between consecutive segments
    angles = []
    for i in range(len(exploded_curves)):
        vec_a = exploded_curves[i].TangentAtEnd
        vec_b = exploded_curves[(i + 1) % len(exploded_curves)].TangentAtStart
        newAngle = rg.Vector3d.VectorAngle(vec_a, vec_b)
        angles.append(newAngle)
        
    # Convert degree input to radians
    radian_limit = ghc.Radians(angle)
    
    # Smaller Than
    smaller_than = ghc.SmallerThan(radian_limit, angles)[0]
    
    # Cull Pattern
    cull_list = ghc.CullPattern(end_points, smaller_than)
        
    return cull_list
    
# Assume 'surface' and 'angle' are provided inputs
colinear_points = meshEdges(surface, angle)
# ---------- end ghpython_script ----------
ghpython_script_2 = GhPythonScript(surface=surface, angle=number_slider)  # -> out, colinear_points, segments; inputs surface: Brep
# ---------- ghpython_script_2: Python ----------
"""Provides a scripting component.
    Inputs:
        surface: The surface script variable
        angle: The angle script variable
    Output:
        colinear points: The a output variable"""

__author__ = "sherft"
__version__ = "2024.06.13"

import rhinoscriptsyntax as rs
import ghpythonlib.components as ghc
import Rhino.Geometry as rg
import math

def meshEdges(surface, angle):
    # Convert surface to mesh
    mesh = rg.Mesh.CreateFromBrep(surface)[0]
    
    # Get naked edges
    naked_edges = mesh.GetNakedEdges()
    
    # Convert naked edges to curves
    curves = []
    for edge in naked_edges:
        if isinstance(edge, rg.Polyline):
            curves.append(edge.ToPolylineCurve())
        else:
            curves.append(edge)
    
    # Join naked edges
    joined_curves = rg.Curve.JoinCurves(curves) 
    
    # Explode joined curves into segments
    exploded_curves = []
    for curve in joined_curves:
        exploded_curves.extend(curve.DuplicateSegments())
        
    # Get endpoints of each segment
    end_points = []
    for curve in exploded_curves:
        end_points.append(curve.PointAtEnd)  
        
     # Calculate angles between consecutive segments
    angles = []
    for i in range(len(exploded_curves)):
        vec_a = exploded_curves[i].TangentAtEnd
        vec_b = exploded_curves[(i + 1) % len(exploded_curves)].TangentAtStart
        newAngle = rg.Vector3d.VectorAngle(vec_a, vec_b)
        angles.append(newAngle)
        
    # Convert degree input to radians
    radian_limit = ghc.Radians(angle)
    
    # Smaller Than
    smaller_than = ghc.SmallerThan(radian_limit, angles)[0]
    
    # Cull Pattern
    cull_list = ghc.CullPattern(end_points, smaller_than)
        
    return cull_list
    
    
def segments(surface):
    # Convert surface to mesh
    mesh = rg.Mesh.CreateFromBrep(surface)[0]
    
    # Get naked edges
    naked_edges = mesh.GetNakedEdges()
    
    # Convert naked edges to curves
    curves = []
    for edge in naked_edges:
        if isinstance(edge, rg.Polyline):
            curves.append(edge.ToPolylineCurve())
        else:
            curves.append(edge)
    
    # Join naked edges
    joined_curves = rg.Curve.JoinCurves(curves) 
    
    # Explode joined curves into segments
    exploded_curves = []
    for curve in joined_curves:
        exploded_curves.extend(curve.DuplicateSegments()) 
        
    return exploded_curves       
    
# Assume 'surface' and 'angle' are provided inputs
colinear_points = meshEdges(surface, angle)
segments = segments(surface)
# ---------- end ghpython_script_2 ----------
point = Point(ghpython_script.colinear_points)
param_viewer = ParamViewer(ghpython_script.colinear_points)
panel = Panel(ghpython_script.colinear_points)
list_length = ListLength(List=point)
equality = Equality(FirstNumber=list_length, SecondNumber=Slider(4, range=0..10))  # -> Equality, Inequality
dispatch = Dispatch(List=point, DispatchPattern=equality.Equality)  # -> ListA, ListB
number_slider_2 = Slider(2, range=0..10)
point_2 = Point(dispatch.ListB)
point_3 = Point(dispatch.ListA)
average = Average(Input=point_3)
tree_statistics = TreeStatistics(Tree=dispatch.ListA)  # -> Paths, Length, Count
point_4 = Point(point_3)
unit_z = UnitZ(Factor=1)
tree_branch = TreeBranch(Tree=dispatch.ListA, Path=tree_statistics.Paths, MaintainPaths=True)
sort_list = SortList(ValuesA=point_4)  # -> Keys, ValuesA
list_item = ListItem(List=tree_branch, Index=0, Wrap=True)
list_item_2 = ListItem(List=tree_branch, Index=Slider(1, range=0..1), Wrap=True)
list_item_3 = ListItem(List=tree_branch, Index=Slider(2, range=0..10), Wrap=True)
list_item_4 = ListItem(List=tree_branch, Index=Slider(3, range=0..10), Wrap=True)
line = Line(StartPoint=list_item, EndPoint=list_item_2)
line_2 = Line(StartPoint=list_item_3, EndPoint=list_item_2)
line_3 = Line(StartPoint=list_item_3, EndPoint=list_item_4)
line_4 = Line(StartPoint=list_item, EndPoint=list_item_4)
network_surface = NetworkSurface(CurvesU=[line, line_3], CurvesV=[line_2, line_4], Continuity=2)
deconstruct_brep = DeconstructBrep(Brep=network_surface)  # -> Faces, Edges, Vertices
evaluate_surface = EvaluateSurface(Surface=deconstruct_brep.Faces, Point="0.5,0.5")  # -> Point, Normal, UDirection, VDirection, Frame
construct_plane = ConstructPlane(Origin=average, XAxis=evaluate_surface.UDirection, YAxis=evaluate_surface.VDirection)
surface_frames = SurfaceFrames(Surface=network_surface, UCount=number_slider_2, VCount=number_slider_2)  # -> Frames, Parameters
vector = Vector(evaluate_surface.Normal)
plane = Plane(evaluate_surface.Frame)
deconstruct_plane = DeconstructPlane(Plane=surface_frames.Frames)  # -> Origin, XAxis, YAxis, ZAxis
deconstruct_plane_2 = DeconstructPlane(Plane=plane)  # -> Origin, XAxis, YAxis, ZAxis
align = AlignPlanes(Planes=evaluate_surface.Frame)
deplane = DeconstructPlane(Plane=evaluate_surface.Frame)  # -> Origin, XAxis, YAxis, ZAxis
dot_product = DotProduct(VectorA=deconstruct_plane.ZAxis, VectorB=average, Unitize=False)
angle = Angle(VectorA=deconstruct_plane_2.YAxis, VectorB=unit_z, Plane=plane)  # -> Angle, Reflex
rotate_plane = RotatePlane(Plane=plane, Angle=angle.Angle)
plane_2 = Plane(rotate_plane)
plane_closest_point = PlaneClosestPoint(Point=point_4, Plane=plane_2)  # -> Point, UVPoint, Distance
panel_2 = Panel(plane_closest_point.UVPoint)
sort_points_polar = SortPointsPolar(Points=point_3, ReferncePlane=rotate_plane)  # -> SortedPoints, SortedValues
tree_statistics_2 = TreeStatistics(Tree=sort_points_polar.SortedPoints)  # -> Paths, Length, Count
tree_branch_2 = TreeBranch(Tree=sort_points_polar.SortedPoints, Path=tree_statistics_2.Paths, MaintainPaths=True)
panel_3 = Panel(dot_product)
tree_branch_3 = TreeBranch(Tree=sort_points_polar.SortedPoints, Path="{0;1}", MaintainPaths=True)
sort_list_2 = SortList(Keys=dot_product, ValuesValuesA=network_surface)  # -> Keys, ValuesValuesA
list_item_5 = ListItem(List=tree_branch_2, Index=Slider(0, range=0..10), Wrap=True)
list_item_6 = ListItem(List=tree_branch_2, Index=Slider(3, range=0..10), Wrap=True)
list_item_7 = ListItem(List=tree_branch_2, Index=Slider(3, range=0..10), Wrap=True)
list_item_8 = ListItem(List=tree_branch_2, Index=Slider(2, range=0..10), Wrap=True)
list_item_9 = ListItem(List=tree_branch_2, Index=Slider(2, range=0..10), Wrap=True)
list_item_10 = ListItem(List=tree_branch_2, Index=Slider(1, range=0..10), Wrap=True)
list_item_11 = ListItem(List=tree_branch_2, Index=Slider(1, range=0..10), Wrap=True)
list_item_12 = ListItem(List=tree_branch_2, Index=Slider(0, range=0..10), Wrap=True)
midpoint = Midpoint(Curve=[line, line_2, line_3, line_4])
line_5 = Line(StartPoint=list_item_7, EndPoint=list_item_5)
line_6 = Line(StartPoint=list_item_9, EndPoint=list_item_6)
line_7 = Line(StartPoint=list_item_11, EndPoint=list_item_8)
line_8 = Line(StartPoint=list_item_12, EndPoint=list_item_10)
sort_list_3 = SortList(Keys=sort_list_2.Keys, ValuesValuesA=network_surface)  # -> Keys, ValuesValuesA
merge = Merge(Data1=line, Data2=line_2, Data3=line_3, Data4=line_4)
average_2 = Average(Input=midpoint)
distance = Distance(PointA=average_2, PointB=midpoint)
merge_2 = Merge(Data1=line_8, Data2=line_7, Data3=line_6, Data4=line_5)
panel_4 = Panel(merge_2)
sort_list_4 = SortList(Keys=distance, ValuesValuesA=midpoint)  # -> Keys, ValuesValuesA
tree_statistics_3 = TreeStatistics(Tree=merge_2)  # -> Paths, Length, Count
sort_list_5 = SortList(Keys=sort_list_4.ValuesValuesA, ValuesValuesA=merge)  # -> Keys, ValuesValuesA
tree_branch_4 = TreeBranch(Tree=merge_2, Path=tree_statistics_3.Paths, MaintainPaths=True)
list_item_13 = ListItem(List=tree_branch_4, Index=Slider(1, range=0..1), Wrap=True)
list_item_14 = ListItem(List=tree_branch_4, Index=0, Wrap=True)
tree_statistics_4 = TreeStatistics(Tree=sort_list_5.ValuesValuesA)  # -> Paths, Length, Count
tree_branch_5 = TreeBranch(Tree=sort_list_5.ValuesValuesA, Path=tree_statistics_4.Paths, MaintainPaths=True)
list_item_15 = ListItem(List=tree_branch_5, Index=Slider(0, range=0..10), Wrap=True)
