# Grasshopper definition Sort Sides_v.0.0.4.gh (Grasshopper 1.0.7)
# plug-ins: Wombat, Pufferfish, Bifocals

surface = Surface([<surface referenced from the Rhino model> x3003])
debrep = DeconstructBrep(Brep=surface)  # -> Faces, Edges, Vertices
reparamsrf = ReparameterizeSurface(Surface=debrep.Faces)  # -> Reparameterized, Original
ghpython_script = GhPythonScript(surface=reparamsrf.Reparameterized, angle=Slider(25.035, range=0..180))  # -> out, colinear_points, segments; inputs surface: Brep
# ---------- ghpython_script: Python ----------
"""Provides a scripting component.
    Inputs:
        surface: The surface script variable
        angle: The angle script variable
    Output:
        colinear points: The a output variable"""

__author__ = "sherft"
__version__ = "2024.06.13"

import rhinoscriptsyntax as rs
import ghpythonlib.components as ghc
import Rhino.Geometry as rg
import math

def meshEdges(surface, angle):
    # Convert surface to mesh
    mesh = rg.Mesh.CreateFromBrep(surface)[0]
    
    # Get naked edges
    naked_edges = mesh.GetNakedEdges()
    
    # Convert naked edges to curves
    curves = []
    for edge in naked_edges:
        if isinstance(edge, rg.Polyline):
            curves.append(edge.ToPolylineCurve())
        else:
            curves.append(edge)
    
    # Join naked edges
    joined_curves = rg.Curve.JoinCurves(curves) 
    
    # Explode joined curves into segments
    exploded_curves = []
    for curve in joined_curves:
        exploded_curves.extend(curve.DuplicateSegments())
        
    # Get endpoints of each segment
    end_points = []
    for curve in exploded_curves:
        end_points.append(curve.PointAtEnd)  
        
     # Calculate angles between consecutive segments
    angles = []
    for i in range(len(exploded_curves)):
        vec_a = exploded_curves[i].TangentAtEnd
        vec_b = exploded_curves[(i + 1) % len(exploded_curves)].TangentAtStart
        newAngle = rg.Vector3d.VectorAngle(vec_a, vec_b)
        angles.append(newAngle)
        
    # Convert degree input to radians
    radian_limit = ghc.Radians(angle)
    
    # Smaller Than
    smaller_than = ghc.SmallerThan(radian_limit, angles)[0]
    
    # Cull Pattern
    cull_list = ghc.CullPattern(end_points, smaller_than)
        
    return cull_list
    
    
def segments(surface):
    # Convert surface to mesh
    mesh = rg.Mesh.CreateFromBrep(surface)[0]
    
    # Get naked edges
    naked_edges = mesh.GetNakedEdges()
    
    # Convert naked edges to curves
    curves = []
    for edge in naked_edges:
        if isinstance(edge, rg.Polyline):
            curves.append(edge.ToPolylineCurve())
        else:
            curves.append(edge)
    
    # Join naked edges
    joined_curves = rg.Curve.JoinCurves(curves) 
    
    # Explode joined curves into segments
    exploded_curves = []
    for curve in joined_curves:
        exploded_curves.extend(curve.DuplicateSegments()) 
        
    return exploded_curves       
    
# Assume 'surface' and 'angle' are provided inputs
colinear_points = meshEdges(surface, angle)
segments = segments(surface)
# ---------- end ghpython_script ----------
panel = Panel(ghpython_script.segments)
param_viewer = ParamViewer(ghpython_script.colinear_points)
panel_2 = Panel(ghpython_script.colinear_points)
join_curves = JoinCurves(Curves=ghpython_script.segments, Preserve=False)
divide_curve = DivideCurve(Curve=join_curves, Count=10, Kinks=False)  # -> Points, Tangents, Parameters
pline = PolyLine(Vertices=divide_curve.Points, Closed=True)
explode = Explode(Curve=join_curves, Recursive=True)  # -> Segments, Vertices
network_surface = NetworkSurface(Continuity=2)
number_slider = Slider(2, range=0..10)
surface_frames = SurfaceFrames(Surface=network_surface, UCount=number_slider, VCount=number_slider)  # -> Frames, Parameters
average = Average()
tree_statistics = TreeStatistics(Tree=explode.Segments)  # -> Paths, Length, Count
deconstruct_plane = DeconstructPlane(Plane=surface_frames.Frames)  # -> Origin, XAxis, YAxis, ZAxis
tree_branch = TreeBranch(Tree=explode.Segments, Path="{0;0;0;0}", MaintainPaths=True)
dot_product = DotProduct(VectorA=deconstruct_plane.ZAxis, VectorB=average, Unitize=False)
curve = Curve(tree_branch)
panel_3 = Panel(dot_product)
list_item = ListItem(List=tree_branch, Index=Slider(0, range=0..10), Wrap=True)
list_item_2 = ListItem(List=tree_branch, Index=Slider(1, range=0..1), Wrap=True)
list_item_3 = ListItem(List=tree_branch, Index=Slider(2, range=0..10), Wrap=True)
list_item_4 = ListItem(List=tree_branch, Index=Slider(3, range=0..10), Wrap=True)
panel_4 = Panel(tree_branch)
sort_list = SortList(Keys=dot_product, ValuesValuesA=network_surface)  # -> Keys, ValuesValuesA
sort_list_2 = SortList(Keys=sort_list.Keys, ValuesValuesA=network_surface)  # -> Keys, ValuesValuesA
midpoint = Midpoint()
merge = Merge()
average_2 = Average(Input=midpoint)
distance = Distance(PointA=average_2, PointB=midpoint)
sort_list_3 = SortList(Keys=distance, ValuesValuesA=midpoint)  # -> Keys, ValuesValuesA
sort_list_4 = SortList(Keys=sort_list_3.ValuesValuesA, ValuesValuesA=merge)  # -> Keys, ValuesValuesA
tree_statistics_2 = TreeStatistics(Tree=sort_list_4.ValuesValuesA)  # -> Paths, Length, Count
tree_branch_2 = TreeBranch(Tree=sort_list_4.ValuesValuesA, Path=tree_statistics_2.Paths, MaintainPaths=True)
list_item_5 = ListItem(List=tree_branch_2, Index=Slider(0, range=0..10), Wrap=True)
