# Grasshopper definition Sort Sides_v.0.4.0.gh (Grasshopper 1.0.8)
# plug-ins: RhinoCodePluginGH, Ankylosaurus

md_slider = MDSlider(SliderMode=0, slider_value=Point(0.5, 0.5, 0.5), x_domain=Domain(0, 1), y_domain=Domain(0, 1), z_domain=Domain(0, 1))
surface = Surface(reparameterize(simplify(graft([<surface referenced from the Rhino model> x3003]))))
panel = Panel(surface)
evaluate_surface = EvaluateSurface(Surface=surface, Point=md_slider)  # -> Point, Normal, UDirection, VDirection, Frame
point = Point(evaluate_surface.Point)
data_input = DataInput(
    Destination="Z:\0002_04_Digital Practice\Computation\Function Library\WIP\Sort Sides\0710\part1.ghdata",
    RelativePath="Z:\0002_04_Digital Practice\Computation\Function Library\WIP\Sort Sides\0710\part1.ghdata|part1.ghdata",
    UpdateDelay=50000)  # -> simplify(colinear_points), simplify(segments)
curve = Curve(flatten(data_input.segments))
panel_2 = Panel(curve)
number_slider = Slider(1, range=0..1)
number_slider_2 = Slider(1, range=0..5)

curve_closest_point = CurveClosestPoint(Point=data_input.colinear_points, Curve=data_input.segments)  # -> Point, Parameter, Distance
shatter = Shatter(Curve=data_input.segments, Parameters=curve_closest_point.Parameter)  # -> simplify(Segments)
list_length = ListLength(List=shatter)
panel_3 = Panel(shatter)
sort_list = SortList(Keys=curve_closest_point.Parameter)  # -> Keys, ValuesValuesA
equality = Equality(FirstNumber=list_length, SecondNumber=Slider(4, range=0..10))  # -> Equality, Inequality
cull_pattern = CullPattern(List=shatter, CullPattern=equality.Equality)
clean_tree = CleanTree(RemoveNulls=True, RemoveInvalid=True, RemoveEmpty=True, Tree=cull_pattern)
panel_4 = Panel(clean_tree)

python_3_script = Python3Script(x=data_input.colinear_points, y=data_input.segments)  # -> out, a, b; inputs x: tree, y: tree
# ---------- python_3_script: Python ----------
import Rhino
import Grasshopper
import rhinoscriptsyntax as rs

def find_closest_point_on_curve(curve, point):
    # Find the parameter of the closest point on the curve
    rc, param = curve.ClosestPoint(point)
    if rc:
        return param
    else:
        return None

# Inputs: points_tree and curves_tree are assumed to be Grasshopper data trees
points_tree = x
curves_tree = y

# Create output data tree for parameters
params_tree = Grasshopper.DataTree[float]()
# Create output data tree for shattered curves
shattered_tree = Grasshopper.DataTree[Rhino.Geometry.Curve]()
# Create output data tree for horizontal curves
horizontal_tree = Grasshopper.DataTree[Rhino.Geometry.Curve]()

# Tolerance for horizontal check (adjust as needed)
tolerance = 0.5  # Increase this value if needed

# Function to check if a curve is horizontal
def is_horizontal(curve):
    # Get the direction vectors of the curve at start and end
    vector_start = curve.TangentAtStart
    vector_end = curve.TangentAtEnd
    
    # Check if the curve is horizontal (parallel to any coordinate plane)
    return (
        abs(vector_start.X) < tolerance and abs(vector_end.X) < tolerance or
        abs(vector_start.Y) < tolerance and abs(vector_end.Y) < tolerance or
        abs(vector_start.Z) < tolerance and abs(vector_end.Z) < tolerance
    )

# Iterate through each branch (list) in the points and curves trees
for i in range(points_tree.BranchCount):
    points_branch = points_tree.Branch(i)
    curves_branch = curves_tree.Branch(i)
    
    # Create a path for the output trees that matches the input branch path
    path = points_tree.Path(i)
    
    # List to store the parameters for the current branch
    params_branch = []
    
    # Iterate through each point in the branch
    for pt in points_branch:
        # Ensure pt is a Rhino.Geometry.Point3d
        pt = rs.coerce3dpoint(pt)
        
        if pt is None:
            continue
        
        closest_param = None
        min_distance = float('inf')
        
        # Iterate through each curve in the branch
        for crv in curves_branch:
            # Ensure crv is a Rhino.Geometry.Curve
            curve = rs.coercecurve(crv)
            
            if not curve:
                continue
                
            param = find_closest_point_on_curve(curve, pt)
            
            if param is not None:
                closest_point = curve.PointAt(param)
                distance = pt.DistanceTo(closest_point)
                
                if distance < min_distance:
                    min_distance = distance
                    closest_param = param
        
        if closest_param is not None:
            params_branch.append(closest_param)
    
    # Add the list of parameters to the output data tree
    params_tree.AddRange(params_branch, path)
    
    # Shatter the curves using the parameters and store the segments
    for crv in curves_branch:
        curve = rs.coercecurve(crv)
        if curve is None:
            continue
        
        # Shatter the curve at the parameters
        shattered_curves = curve.Split(params_branch)
        
        if shattered_curves:
            shattered_tree.AddRange(shattered_curves, path)

# Filter horizontal curves
for i in range(shattered_tree.BranchCount):
    curves_branch = shattered_tree.Branch(i)
    path = shattered_tree.Path(i)
    
    for curve in curves_branch:
        # Check if the curve is horizontal
        if is_horizontal(curve):
            horizontal_tree.Add(curve, path)

# Output the results
a = shattered_tree  # All shattered curves
b = horizontal_tree  # Horizontal curves
# ---------- end python_3_script ----------
panel_5 = Panel(data_input.segments)
separate_segments_by_direction = SeparateSegmentsByDirection(Polyline=data_input.segments, Vector=Vector(0, 0, 1), Tolerance=0.02)  # -> CurveA, CurveB
panel_6 = Panel(curve_closest_point.Parameter)
curve_2 = Curve(python_3_script.a)
curve_3 = Curve(python_3_script.b)
panel_7 = Panel(python_3_script.b)
panel_8 = Panel(python_3_script.a)
python_3_script_2 = Python3Script(x=surface, y=data_input.colinear_points, z=Slider(5, range=0..10))  # -> out, a, b, c, d; inputs x: tree, y: tree
# ---------- python_3_script_2: Python ----------
import rhinoscriptsyntax as rs
import ghpythonlib.components as ghc
import ghpythonlib.treehelpers as th
from ghpythonlib import clr

# Adjust the Grasshopper DLL path as needed for your installation
grasshopper_dll_path = r"C:\Program Files\Rhino 8\Plug-ins\Grasshopper\Grasshopper.dll"
clr.AddReference(grasshopper_dll_path)

from Grasshopper import DataTree as DataTree
from Rhino.Geometry import Surface, Plane, Point3d, Vector3d, Curve
from Rhino import RhinoDoc

def merge_data_trees(tree1, tree2):
    merged_tree = DataTree[object]()
    
    # Add branches from the first tree
    for i in range(tree1.BranchCount):
        path = tree1.Path(i)
        branch = tree1.Branch(path)
        for item in branch:
            merged_tree.Add(item, path)
    
    # Add branches from the second tree
    for i in range(tree2.BranchCount):
        path = tree2.Path(i)
        branch = tree2.Branch(path)
        for item in branch:
            if merged_tree.PathExists(path):
                merged_tree.Branch(path).Add(item)
            else:
                merged_tree.Add(item, path)
    
    return merged_tree

def get_list_lengths(tree):
    length_tree = DataTree[int]()
    for i in range(tree.BranchCount):
        path = tree.Path(i)
        branch = tree.Branch(path)
        length_tree.Add(len(branch), path)
    return length_tree

def check_equality(tree1, z):
    equality_tree = DataTree[bool]()
    for i in range(tree1.BranchCount):
        path = tree1.Path(i)
        branch1 = tree1.Branch(path)
        equality = [ghc.Equality(item, z)[0] for item in branch1]
        for result in equality:
            equality_tree.Add(result, path)
    return equality_tree

# Merge the trees
merged_tree = merge_data_trees(x, y)

# Get the lengths of each branch in the merged tree
length_tree = get_list_lengths(merged_tree)

# Perform equality check with z
equality_tree = check_equality(length_tree, z)

# Initialize filtered_merged_tree
filtered_merged_tree = DataTree[object]()

# Add branches from merged_tree based on equality_tree
for i in range(equality_tree.BranchCount):
    path = equality_tree.Path(i)
    if equality_tree.Branch(path)[0]:  # Check the boolean value at each path
        branch = merged_tree.Branch(path)
        for item in branch:
            filtered_merged_tree.Add(item, path)

# Split items within branches of filtered_merged_tree
a = filtered_merged_tree
b = DataTree[object]()
c = DataTree[object]()

for i in range(filtered_merged_tree.BranchCount):
    path = filtered_merged_tree.Path(i)
    branch = filtered_merged_tree.Branch(path)
    for j, item in enumerate(branch):
        if j < 1:
            b.Add(item, path)
        else:
            c.Add(item, path)

# Generate planes from surfaces in b
d = DataTree[object]()
for i in range(b.BranchCount):
    path = b.Path(i)
    branch = b.Branch(path)
    for guid in branch:
        # Convert GUID to Rhino object
        brep = rs.coercebrep(guid)
        
        if brep is None or not brep.Faces:
            continue
        
        # Use the first face for simplicity
        surface = brep.Faces[0]
        
        # Get the midpoint parameters
        u, v = surface.Domain(0), surface.Domain(1)
        mid_u, mid_v = (u[0] + u[1]) / 2, (v[0] + v[1]) / 2
        
        # Obtain the frame (plane) at the midpoint
        plane = surface.FrameAt(mid_u, mid_v)[1]  # The second item in the tuple is the plane
        
        # Add the plane to d
        d.Add(plane, path)
# ---------- end python_3_script_2 ----------
deconstruct_plane = DeconstructPlane(Plane=python_3_script_2.d)  # -> Origin, XAxis, YAxis, ZAxis
separate_segments_by_direction_2 = SeparateSegmentsByDirection(Polyline=data_input.segments, Vector=deconstruct_plane.ZAxis, Tolerance=Slider(0.3, range=0..1))  # -> CurveA, CurveB
curve_4 = Curve(separate_segments_by_direction_2.CurveB)
curve_5 = Curve(separate_segments_by_direction_2.CurveA)
vector_display = VectorDisplay(Anchor=point, Vector=deconstruct_plane.XAxis)
panel_9 = Panel(curve_5)
panel_10 = Panel(curve_4)
panel_11 = Panel(python_3_script_2.d)

surface_2 = Surface([<surface referenced from the Rhino model> x3003])
radians = Radians(Degrees=Slider(115, range=0..1000))
md_slider_2 = MDSlider(SliderMode=0, slider_value=Point(0.5, 0.5, 0.5), x_domain=Domain(0, 1), y_domain=Domain(0, 1), z_domain=Domain(0, 1))

list_item = ListItem(List=surface_2, Index=0, Wrap=True)
unify_uvs_by_guide_srf = UnifyUVsByGuideSrf(Breps=surface_2, GuideSurface=list_item, Tolerance=radians)
surface_rationalize = SurfaceRationalize(SurfacePanels=surface_2, Planarize=True, UVParameter=Point(0, 0, 0))
swap_surface_direction = SwapSurfaceDirection(Surface=unify_uvs_by_guide_srf, FlipSurface=False, SwapSurfaceDirection=False, ReverseU=False, ReverseV=True)

evaluate_surface_2 = EvaluateSurface(Surface=reparameterize(swap_surface_direction), Point=md_slider_2)  # -> Point, Normal, UDirection, VDirection, Frame

deconstruct_plane_2 = DeconstructPlane(Plane=evaluate_surface_2.Frame)  # -> Origin, XAxis, YAxis, ZAxis
separate_segments_by_direction_3 = SeparateSegmentsByDirection(Polyline=surface_2, Vector=deconstruct_plane_2.YAxis, Tolerance=Slider(1.1, range=0..10))  # -> CurveA, CurveB
point_2 = Point(deconstruct_plane_2.ZAxis)
curve_6 = Curve(separate_segments_by_direction_3.CurveA)
curve_7 = Curve(separate_segments_by_direction_3.CurveB)
